# Grasshopper definition Press Fit 2.gh (Grasshopper 0.9.80)

cir = Circle(Plane=PlaneXY(0, 0, 0), Radius=Slider(25, range=0..50))
rectangle = Rectangle(Plane=PlaneXY(25, 0, 0), XSize=Slider(-10, range=-15..15), YSize=Slider(2.54, range=-15..15), Radius=0)  # -> Rectangle, Length
rectangle_2 = Rectangle(Plane=PlaneXY(0, 25, 0), XSize=Slider(2.54, range=-15..15), YSize=Slider(-10, range=-15..15), Radius=0)  # -> Rectangle, Length
rectangle_3 = Rectangle(Plane=PlaneXY(0, -25, 0), XSize=Slider(2.54, range=-15..15), YSize=Slider(10, range=-15..15), Radius=0)  # -> Rectangle, Length
rectangle_4 = Rectangle(Plane=PlaneXY(-25, 0, 0), XSize=Slider(10, range=-15..15), YSize=Slider(2.54, range=-15..15), Radius=0)  # -> Rectangle, Length
rectangle_5 = Rectangle(Plane=PlaneXY(188, -56, 0), XSize=Slider(2.54, range=-15..15), YSize=Slider(-10, range=-15..15), Radius=0)  # -> Rectangle, Length
rectangle_6 = Rectangle(
    Plane=Plane(origin=(212, -82, 0), x=(-1, 0, 0), y=(0, 1, 0)),
    XSize=Slider(10, range=-15..15),
    YSize=Slider(2.54, range=-15..15),
    Radius=0)  # -> Rectangle, Length
rectangle_7 = Rectangle(Plane=PlaneXY(162, -81, 0), XSize=Slider(10, range=-15..15), YSize=Slider(2.54, range=-15..15), Radius=0)  # -> Rectangle, Length
rectangle_8 = Rectangle(Plane=PlaneXY(187, -106, 0), XSize=Slider(2.54, range=-15..15), YSize=Slider(10, range=-15..15), Radius=0)  # -> Rectangle, Length
rectangle_9 = Rectangle(Plane=PlaneXY(162, -106, 0), XSize=Slider(50, range=0..50), YSize=Slider(50, range=0..50), Radius=0)  # -> Rectangle, Length
rdiff = RegionDifference(CurvesA=cir, CurvesB=rectangle_2.Rectangle)
rdiff_2 = RegionDifference(CurvesA=rdiff, CurvesB=rectangle.Rectangle)
rdiff_3 = RegionDifference(CurvesA=rectangle_9.Rectangle, CurvesB=rectangle_5.Rectangle)
rdiff_4 = RegionDifference(CurvesA=rdiff_2, CurvesB=rectangle_3.Rectangle)
rdiff_5 = RegionDifference(CurvesA=rdiff_3, CurvesB=rectangle_6.Rectangle)
rdiff_6 = RegionDifference(CurvesA=rdiff_4, CurvesB=rectangle_4.Rectangle)
rdiff_7 = RegionDifference(CurvesA=rdiff_5, CurvesB=rectangle_7.Rectangle)
rdiff_8 = RegionDifference(CurvesA=rdiff_7, CurvesB=rectangle_8.Rectangle)
