# Grasshopper definition asnal.gh (Grasshopper 0.9.80)

rectangle = Rectangle(Plane=PlaneXY(0, 0, 0), XSize=Slider(200, range=1..500), YSize=Slider(50, range=1..500), Radius=0)  # -> Rectangle, Length
rectangle_2 = Rectangle(Plane=PlaneXY(-21, -6, 0), XSize=Slider(50, range=1..500), YSize=Slider(50, range=1..500), Radius=0)  # -> Rectangle, Length
